# Grasshopper definition gridMesh_test.gh (Grasshopper 1.0.7)
# plug-ins: Hops

hops = Hops(
    _Path="http://127.0.0.1:5000/gridMesh",
    U_count=Slider(8, range=0..10),
    V_count=Slider(9, range=0..10),
    CacheResultsInMemory=True,
    CacheSolveResults=True,
    RemoteDefinitionLocation="http://127.0.0.1:5000/gridMesh",
    RemoteSolveVersion=(0, 1, 0),
    ShowInput_Enabled=False,
    ShowInput_Path=True,
    SynchronousSolve=True)
