# Grasshopper definition shortest_path_test.gh (Grasshopper 1.0.7)
# plug-ins: Hops, Kangaroo2 Components

mesh = Mesh(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)
triremesh = TriRemesh(Geometry=mesh, Length=1, Iterations=25)  # -> Triangulation, Dual, Creases
explodemesh = GhPythonScript(m=triremesh.Triangulation)  # -> out, a; inputs m: Mesh
# ---------- explodemesh: Python ----------
import Rhino.Geometry as rg

ghenv.Component.Message = "explode mesh"

exploded = []

for i in range(m.Faces.Count):
    m_copy = m.Duplicate()
    face = m_copy.Faces.ExtractFaces([i])
    exploded.append(face)
    
a = exploded
# ---------- end explodemesh ----------
lng = ListLength(List=explodemesh.a)  # -> expr("x-1", Length)
random = Random(Range=lng, Number=1, Seed=2)
random_2 = Random(Range=lng, Number=1, Seed=Slider(29, range=0..100))
int = Integer(random)
int_2 = Integer(random_2)
hops = Hops(
    _Path="http://127.0.0.1:5000/shortestpath",
    InputMesh=triremesh.Triangulation,
    FaceIndex1=int,
    FaceIndex2=int_2,
    CacheResultsInMemory=True,
    CacheSolveResults=True,
    RemoteDefinitionLocation="http://127.0.0.1:5000/shortestpath",
    RemoteSolveVersion=(0, 1, 0),
    ShowInput_Enabled=False,
    ShowInput_Path=True,
    SynchronousSolve=True)
item = ListItem(List=explodemesh.a, Index=hops, Wrap=True)
preview = CustomPreview(
    Geometry=item,
    Material={diffuse=RGB(228, 178, 227), emission=RGB(68, 53, 68), shine=0.5, specular=RGB(255, 254, 254), transparency=0})
